# Grasshopper definition AGGREGATE.gh (Grasshopper 1.0.7)
# plug-ins: FileToScript

dir_type = ValueList({"desktop": 0, "documents": 1, "GH file path": 2, "C:": 3}, selected="GH file path")
f_ghfilepath = GHFilePathInfo()  # -> F, P
# ---------- f_ghfilepath: C# ----------
                                      /*
    froGH - a sparse collection of (in)utilities for Grasshopper

    GH File and Path info

    code by Alessio Erioli

    froGH by Co-de-iT is licensed under a Creative Commons Attribution 4.0 International License.
    http://creativecommons.org/licenses/by/4.0/

    */

    initComp();

    GH_Document ghDoc = Grasshopper.Instances.ActiveCanvas.Document;

    int nameLen = ghDoc.DisplayName.TrimEnd('*').Length + 3; // +3 accounts for the '.gh' extension
    int fileLen = ghDoc.FilePath.TrimEnd('*').Length;

    F = ghDoc.DisplayName.TrimEnd('*');
    P = ghDoc.FilePath.Substring(0, fileLen - nameLen);
# ---------- f_ghfilepath: C# additional code ----------
  void initComp(){

    Component.Name = "GH File Path Info";
    Component.NickName = "f_GHFilePath";
    Component.Description = "Provides info on current Grasshopper Document file name and path\nUseful for exporting files with the same name as the gh file and in the same directory";
    Component.Params.Output[0].Name = "File Name";
    Component.Params.Output[0].Description = "Current GH file name";
    Component.Params.Output[1].Name = "File Path";
    Component.Params.Output[1].Description = "Current GH file path";
  }
# ---------- end f_ghfilepath ----------
panel = Panel(f_ghfilepath.P)
f_pathg = PathGenerator(type=dir_type, subDir="Beaver\Beaver")  # -> dir; inputs type: Int32, subDir: String
# ---------- f_pathg: C# ----------
                           /*
    froGH - a sparse collection of (in)utilities for Grasshopper

    Path Generator
    code by Alessio Erioli - value list generation based on code by James Ramsden

    froGH by Co-de-iT is licensed under a Creative Commons Attribution 4.0 International License.
    http://creativecommons.org/licenses/by/4.0/

    */
    initComp();


    String S = "";
    String root = "";
    String end = "\\";
    String eol = Environment.NewLine;

    // __________________ autoList part __________________

    // variable for the list
    Grasshopper.Kernel.Special.GH_ValueList vList;
    // tries to cast input as list
    try{

      // if the list is not the first parameter then change Input[0] to the corresponding value
      vList = (Grasshopper.Kernel.Special.GH_ValueList) Component.Params.Input[0].Sources[0];
      // Print("value list connected");
      // check if the list must be created
      //if (vList.NickName != "dir type"){
      if (!vList.NickName.Equals("dir type")){
        vList.ClearData();
        vList.ListItems.Clear();
        vList.NickName = "dir type";
        var item1 = new Grasshopper.Kernel.Special.GH_ValueListItem("desktop", "0");
        var item2 = new Grasshopper.Kernel.Special.GH_ValueListItem("documents", "1");
        var item3 = new Grasshopper.Kernel.Special.GH_ValueListItem("GH file path", "2");
        var item4 = new Grasshopper.Kernel.Special.GH_ValueListItem("C:", "3");
        vList.ListItems.Add(item1);
        vList.ListItems.Add(item2);
        vList.ListItems.Add(item3);
        vList.ListItems.Add(item4);

        vList.ListItems[0].Value.CastTo(out type);
      }
    }
    catch{
      // handles anything that is not a value list
    }


    switch(type){
      case 0:
        root = Environment.GetFolderPath(Environment.SpecialFolder.Desktop) + end;
        S = "Desktop";
        break;
      case 1:
        root = Environment.GetFolderPath(Environment.SpecialFolder.MyDocuments) + end;
        S = "Documents";
        break;
      case 2:
        GH_Document ghDoc = owner.OnPingDocument();

        if (ghDoc.IsFilePathDefined)
        {
          int nameLen = ghDoc.DisplayName.TrimEnd('*').Length + 3; // +3 accounts for the '.gh' extension
          int fileLen = ghDoc.FilePath.TrimEnd('*').Length;

          //F = ghDoc.DisplayName.TrimEnd('*');
          root = ghDoc.FilePath.Substring(0, fileLen - nameLen);
          //root = gh_d.FilePath;
          S = "GH File path";
        }
        else
        {
          Print("No path defined. Saving to Desktop until then");
          root = Environment.GetFolderPath(Environment.SpecialFolder.Desktop);
          S = "Desktop";
        }
        break;
      case 3:
        root = "C:" + end;
        S = root + end;
        break;
    }
    dir = root + (subDir != null ? (subDir + end) : "");
    Component.Message = S;
# ---------- f_pathg: C# additional code ----------
  void initComp(){
    Component.Name = "Path Generator";
    Component.NickName = "f_PathG";
    Component.Description = "generates a path based on local direcories such as Desktop, Documents, GH file path";
    Component.Params.Input[0].Name = "dir type";
    Component.Params.Input[0].Description = "directory type: 0 desktop, 1 documents, 2 GH file path, 3 C:\nconnect a value list for automatic list generation";
    Component.Params.Input[1].Name = "custom subdir";
    Component.Params.Input[1].Description = "(optional) custom subdirectory";
  }
# ---------- end f_pathg ----------
panel_2 = Panel("D:\DESIGN BY DATA\COURSE\97_THESIS\AGGREGATE\BEAVER\BEAVER\BEAVER.cs")
concat = Concatenate(FragmentA=f_pathg, FragmentB="BeaverComponent.cs")
path = FilePath(panel_2)
panel_3 = Panel("""10
10""")
c_script = CSharpScript(l=panel_3, w=panel_3, t=panel_3)  # -> out, A; inputs l: Double, w: Double, t: Double
# ---------- c_script: C# ----------
        aggregate aggregate = new aggregate();
        aggregate.Name = "agg";
        aggregate.Length = _l;
        aggregate.Width = _w;
        aggregate.Thickness = _t;
        A = aggregate;
# ---------- c_script: C# additional code ----------
 
  public class aggregate
    {
        private string agg_name;
        public string Name
        {
            get { return agg_name; }
            set { agg_name = value;  }
        }
        private int agg_Id;
        public int Id
        {
            get { return agg_Id; }
            set { agg_Id = value; }
        }
        private double agg_length;
        public double Length
        {
            get { return agg_length; }
            set { agg_length = value; }
        }
        private double agg_width;
        public double Width
        {
            get { return agg_width; }
            set { agg_width = value; }
        }
        private double agg_thickness;
        public double Thickness
        {
            get { return agg_thickness; }
            set { agg_thickness = value; }
        }
        private int agg_xFreedom;
        public int XFreedom
        {
            get { return agg_xFreedom; }
            set { agg_xFreedom = 2; }
        }
        private int agg_yFreedom;
        public int YFreedom
        {
            get { return agg_yFreedom; }
            set { agg_yFreedom = 2; }
        }
        private int agg_zFreedom;
        public int ZFreedom
        {
            get { return agg_zFreedom; }
            set { agg_zFreedom = 2; }
        }
        private double agg_xPos;
        public double XPos
        {
            get { return agg_xPos; }
            set { agg_xPos = value; }
        }
        private double agg_yPos;
        public double YPos
        {
            get { return agg_yPos; }
            set { agg_yPos = value; }
        }
        private double agg_zPos;
        public double ZPos
        {
            get { return agg_zPos; }
            set { agg_zPos = value; }
        }

    }
# ---------- end c_script ----------
ftsv2 = FileToScriptV2(File=path)
panel_4 = Panel(c_script.A)
